# Dynamo graph all_elements_extraction.dyn "(排版过的)all相邻房间信息导出excel2" (Dynamo 2.1.0.7500)

# group: Obtain all the doors element in the model
code_block = CodeBlock { "door"; }
byName = Category.ByName(name=code_block)
all_elements_of_category = ElementsOfCategory(Category=byName)

# group: Obtain each element
all_element = Python()  # unwired: IN[0], IN[1]
# ---------- all_element.python (26 lines) ----------
import clr
clr.AddReference('RevitAPI')
from Autodesk.Revit.DB import *
import Autodesk

clr.AddReference("RevitNodes")
import Revit
clr.ImportExtensions(Revit.Elements)

clr.AddReference("RevitServices")
import RevitServices
from RevitServices.Persistence import DocumentManager

inputdoc = UnwrapElement(IN[1])
if inputdoc == None:
	doc = DocumentManager.Instance.CurrentDBDocument
elif inputdoc.GetType().ToString() == "Autodesk.Revit.DB.RevitLinkInstance":
	doc = inputdoc.GetLinkDocument()
elif inputdoc.GetType().ToString() == "Autodesk.Revit.DB.Document":
	doc = inputdoc
else: doc = None

elementlist = []
for phase in doc.Phases:
	elementlist.append(phase.ToDSType(True))
OUT = elementlist
# ----------------------------------------
code_block_2 = CodeBlock(a=all_element) { a[1]; }
code_block_3 = CodeBlock(e=all_element) { e.Name; }

# group: Obtain connected room elements inside and outside based on the door
python_script = Python(IN[0]=all_elements_of_category, IN[1]=code_block_2)
# ---------- python_script.python (33 lines) ----------
import clr
clr.AddReference('RevitAPI')
from Autodesk.Revit.DB import *
import Autodesk

clr.AddReference("RevitNodes")
import Revit
clr.ImportExtensions(Revit.Elements)

clr.AddReference("RevitServices")
import RevitServices
from RevitServices.Persistence import DocumentManager

doc = DocumentManager.Instance.CurrentDBDocument

items = IN[0]
rtn=[]

for phase in doc.Phases:
	for item in items:
		item=UnwrapElement(item)
		try:
			froom=item.FromRoom[phase]
		except:
			froom=None
		try:
			troom=item.ToRoom[phase]
		except:
			troom=None
	
		rtn.append([phase, item, froom, troom])
		
OUT = rtn
# ----------------------------------------
python_script_2 = Python(IN[0]=python_script)
# ---------- python_script_2.python (20 lines) ----------
# 加载 Python Standard 和 DesignScript 库
import sys
import clr
clr.AddReference('ProtoGeometry')
from Autodesk.DesignScript.Geometry import *

# 该节点的输入内容将存储为 IN 变量中的一个列表。
data = IN[0]

out = []
only = []
for d in data:
	if d[2] == None or d[3] == None:
		only.append(d)
	else:
		out.append(d)
# 将代码放在该行下面

# 将输出内容指定给 OUT 变量。
OUT = out,only
# ----------------------------------------
code_block_4 = CodeBlock(a=python_script_2) { a[0]; }
transpose = List.Transpose(lists=code_block_4)
code_block_5 = CodeBlock(a=transpose) { a[2]; }
code_block_6 = CodeBlock(e=code_block_5) { e.Name; }
code_block_7 = CodeBlock(a=transpose) { a[3]; }
code_block_8 = CodeBlock(e=code_block_7) { e.Name; }
code_block_9 = CodeBlock(a=code_block_6, b=code_block_8) { a +" links "+ b; }

# group: Obtain all the room elements in the model
code_block_10 = CodeBlock { "房间"; }
byName_2 = Category.ByName(name=code_block_10)
all_elements_of_category_2 = ElementsOfCategory(Category=byName_2)

# group: Dealing with special building spaces
code_block_11 = CodeBlock { "Lift"; }
contains = String.Contains(searchFor=code_block_11)  # unwired: str
filterByBoolMask = List.FilterByBoolMask(list=all_elements_of_category_2, mask=contains)
code_block_12 = CodeBlock(e=all_elements_of_category_2) { e.Name; }
code_block_13 = CodeBlock { "Lobby"; }
contains_2 = String.Contains(str=code_block_12, searchFor=code_block_13)
filterByBoolMask_2 = List.FilterByBoolMask(list=all_elements_of_category_2, mask=contains_2)
location = Room.Location(room=filterByBoolMask.in)
location_2 = Room.Location(room=filterByBoolMask_2.in)
distanceTo = Geometry.DistanceTo(geometry=location, other=location_2, lacing=CrossProduct)
python_script_list_minindex = Python(IN[0]=distanceTo)
# ---------- python_script_list_minindex.python (12 lines) ----------
def tolist(x):
	if hasattr(x,'__iter__'): return x
	return [x]

Alldata = tolist(IN[0])
index = []

for data in Alldata:
	index.append(min(enumerate(data), key=lambda x: x[1]))
OUT = index

#OUT = min(enumerate(data), key=lambda x: x[1])
# ----------------------------------------
transpose_2 = List.Transpose(lists=python_script_list_minindex)
code_block_14 = CodeBlock(a=transpose_2) { a[0]; }

# group: Obtain the door connected to the open space
code_block_15 = CodeBlock(a=python_script_2) { a[1]; }
python_script_3 = Python(IN[0]=code_block_15)
# ---------- python_script_3.python (25 lines) ----------
# 加载 Python Standard 和 DesignScript 库
import sys
import clr
clr.AddReference('ProtoGeometry')
from Autodesk.DesignScript.Geometry import *

# 该节点的输入内容将存储为 IN 变量中的一个列表。
data = IN[0]

out = []
only = []
door = []
for d in data:
	if d[2] == None and d[3] != None:
		only.append(d)
		door.append(d[3])
	elif d[2] != None and d[3] == None:
		only.append(d)
		door.append(d[2])
	else:
		out.append(d)
# 将代码放在该行下面

# 将输出内容指定给 OUT 变量。
OUT = out,only,door
# ----------------------------------------
code_block_16 = CodeBlock(a=python_script_3) { a[2]; }
code_block_17 = CodeBlock(e=code_block_16) { e.Name; }
code_block_18 = CodeBlock(a=code_block_17) { a +" links openspace"; }

# group: Generate triplets of 'links' relationships and remove duplicate connections
code_block_19 = CodeBlock(e=filterByBoolMask.in) { e.Name; }
getItemAtIndex = List.GetItemAtIndex(list=filterByBoolMask_2.in, index=code_block_14)
code_block_20 = CodeBlock(e=getItemAtIndex) { e.Name; }
code_block_21 = CodeBlock(a=code_block_19, b=code_block_20) { a +" links "+ b; }
join = List.Join(list0=code_block_9, list1=code_block_21, list2=code_block_18)
code_block_22 = CodeBlock { " links "; }
split = String.Split(str=join, separator0=code_block_22)
count = List.Count(list=split)
code_block_23 = CodeBlock { "links"; }
ofRepeatedItem = List.OfRepeatedItem(item=count, amount=code_block_23)
transpose_3 = List.Transpose(lists=split)
code_block_24 = CodeBlock(a=transpose_3) { a[0]; }
code_block_25 = CodeBlock(a=transpose_3) { a[1]; }
list_create = List.Create(item0=ofRepeatedItem, item1=code_block_24, item2=code_block_25)

# group: Obtain all the room elements in the model
code_block_26 = CodeBlock { "room"; }
byName_3 = Category.ByName(name=code_block_26)
all_elements_of_category_3 = ElementsOfCategory(Category=byName_3)

# group: Obtain the name of the target families
code_block_27 = CodeBlock { ["常规模型","管道附件","数据设备","火警设备","机械设备","喷头"]; }
byName_4 = Category.ByName(name=[code_block_27, code_block_27])
all_elements_of_category_4 = ElementsOfCategory(Category=byName_4)
flatten = List.Flatten(list=all_elements_of_category_4)

# group: Obtain the geometric center of the equipment
boundingBox = Element.BoundingBox(element=flatten)
minPoint = BoundingBox.MinPoint(boundingBox=boundingBox)
maxPoint = BoundingBox.MaxPoint(boundingBox=boundingBox)
byStartPointEndPoint = Line.ByStartPointEndPoint(startPoint=minPoint, endPoint=maxPoint)
code_block_28 = CodeBlock { 0.5; }
pointAtParameter = Curve.PointAtParameter(curve=byStartPointEndPoint, param=code_block_28)

# group: Search for equipment in the room
isInsideRoom = Room.IsInsideRoom(room=all_elements_of_category_3, point=pointAtParameter@L1)
filterByBoolMask_3 = List.FilterByBoolMask(list=all_elements_of_category_3, mask=isInsideRoom@L2)
code_block_29 = CodeBlock(a=filterByBoolMask_3.in) { a; }
name = Element.Name(element=code_block_29)
python_script_4 = Python(IN[0]=name)
# ---------- python_script_4.python (20 lines) ----------
# 加载 Python Standard 和 DesignScript 库
import sys
import clr
clr.AddReference('ProtoGeometry')
from Autodesk.DesignScript.Geometry import *

# 该节点的输入内容将存储为 IN 变量中的一个列表。
data = IN[0]

out = []
for d in data:
	if d != []:
		out.append(d[0])
	else:
		out.append("")

# 将代码放在该行下面

# 将输出内容指定给 OUT 变量。
OUT = out
# ----------------------------------------
code_block_30 = CodeBlock { ""; }
eq = python_script_4 == code_block_30
filterByBoolMask_4 = List.FilterByBoolMask(list=python_script_4, mask=eq)

# group: Obtain device family and family type names
filterByBoolMask_5 = List.FilterByBoolMask(list=flatten, mask=eq)
getFamily = FamilyInstance.GetFamily(familyInstance=filterByBoolMask_5.out)
code_block_31 = CodeBlock(e=getFamily) { e.Name; }
code_block_32 = CodeBlock(e=filterByBoolMask_5.out) { e.Name; }
code_block_33 = CodeBlock(f=code_block_31, t=code_block_32) { f+":"+t; }
code_block_34 = CodeBlock { "has"; }
count_2 = List.Count(list=code_block_33)
ofRepeatedItem_2 = List.OfRepeatedItem(item=code_block_34, amount=count_2)

# group: Generate triplets of 'has' relationship
sortByKey = List.SortByKey(list=filterByBoolMask_4.out, keys=code_block_33)
python_script_5 = Python(IN[0]=sortByKey.sorted_keys)
# ---------- python_script_5.python (24 lines) ----------
def count_consecutive_elements(lst):
    count = 1
    ele = []
    num = []
    
    for i in range(len(lst) - 1):
        if lst[i] == lst[i+1]:
            count += 1
        else:
            ele.append(lst[i],)
            num.append(count)
            count = 1
    
    ele.append(lst[-1])
    num.append(count)
    
    return ele,num

# 示例用法
my_list = IN[0]

consecutive_counts = count_consecutive_elements(my_list)

OUT = consecutive_counts
# ----------------------------------------
code_block_35 = CodeBlock(a=python_script_5) { a[1]; }
python_script_6 = Python(IN[0]=code_block_35)
# ---------- python_script_6.python (21 lines) ----------
# 加载 Python Standard 和 DesignScript 库
import sys
import clr
clr.AddReference('ProtoGeometry')
from Autodesk.DesignScript.Geometry import *

# 该节点的输入内容将存储为 IN 变量中的一个列表。
data = IN[0]
out = []
for d in data:
	if d == 1:
		out.append("")
	else:
		lst = range(1,d+1)
		for l in lst:
			out.append(l)		

# 将代码放在该行下面

# 将输出内容指定给 OUT 变量。
OUT = out
# ----------------------------------------
string_from_object = FromObject(obj=python_script_6)
code_block_36 = CodeBlock { 3; }
code_block_37 = CodeBlock { "0"; }
padLeft = String.PadLeft(str=string_from_object, newWidth=code_block_36, padChars=code_block_37)
python_script_7 = Python(IN[0]=padLeft)
# ---------- python_script_7.python (20 lines) ----------
# 加载 Python Standard 和 DesignScript 库
import sys
import clr
clr.AddReference('ProtoGeometry')
from Autodesk.DesignScript.Geometry import *

# 该节点的输入内容将存储为 IN 变量中的一个列表。
data = IN[0]
out = []

for d in data:
	if d == "000":
		out.append("")
	else:
		out.append("-"+d)

# 将代码放在该行下面

# 将输出内容指定给 OUT 变量。
OUT = out
# ----------------------------------------
code_block_38 = CodeBlock(a=sortByKey.sorted_keys, b=python_script_7) { a+b; }
list_create_2 = List.Create(item0=sortByKey.sorted_list, item1=ofRepeatedItem_2, item2=code_block_38)

# group: Data integration
file_path = Filename(".\房间联通信息导出.xlsx")
code_block_39 = CodeBlock { "Sheet1"; }
code_block_40 = CodeBlock { 0; 0; }
join_2 = List.Join()  # unwired: list0, list1
combine = List.Combine(comb=join_2, list1=list_create, list2=list_create_2)
transpose_4 = List.Transpose(lists=combine)
exportExcel = Data.ExportExcel(filePath=file_path, sheetName=code_block_39, startRow=code_block_40.out0, startCol=code_block_40.out1, data=transpose_4)

getLocation = Element.GetLocation()  # frozen; unwired: element
flatten_2 = List.Flatten(list=getLocation)
