# Dynamo graph equipment_elements_extraction.dyn "相邻房间信息导出excel" (Dynamo 2.3.2.15696)

file_path = Filename(".\房间联通信息导出.xlsx")
code_block = CodeBlock { "Sheet1"; }
code_block_2 = CodeBlock { 0; 0; }
code_block_3 = CodeBlock { "门"; }
byName = Category.ByName(name=code_block_3)
all_elements_of_category = ElementsOfCategory(Category=byName)
all_phase = Python()  # unwired: IN[0], IN[1]
# ---------- all_phase.python (26 lines) ----------
import clr
clr.AddReference('RevitAPI')
from Autodesk.Revit.DB import *
import Autodesk

clr.AddReference("RevitNodes")
import Revit
clr.ImportExtensions(Revit.Elements)

clr.AddReference("RevitServices")
import RevitServices
from RevitServices.Persistence import DocumentManager

inputdoc = UnwrapElement(IN[1])
if inputdoc == None:
	doc = DocumentManager.Instance.CurrentDBDocument
elif inputdoc.GetType().ToString() == "Autodesk.Revit.DB.RevitLinkInstance":
	doc = inputdoc.GetLinkDocument()
elif inputdoc.GetType().ToString() == "Autodesk.Revit.DB.Document":
	doc = inputdoc
else: doc = None

elementlist = []
for phase in doc.Phases:
	elementlist.append(phase.ToDSType(True))
OUT = elementlist
# ----------------------------------------
code_block_4 = CodeBlock(a=all_phase) { a[1]; }
python_script = Python(IN[0]=all_elements_of_category, IN[1]=code_block_4)
# ---------- python_script.python (33 lines) ----------
import clr
clr.AddReference('RevitAPI')
from Autodesk.Revit.DB import *
import Autodesk

clr.AddReference("RevitNodes")
import Revit
clr.ImportExtensions(Revit.Elements)

clr.AddReference("RevitServices")
import RevitServices
from RevitServices.Persistence import DocumentManager

doc = DocumentManager.Instance.CurrentDBDocument

items = IN[0]
rtn=[]

for phase in doc.Phases:
	for item in items:
		item=UnwrapElement(item)
		try:
			froom=item.FromRoom[phase]
		except:
			froom=None
		try:
			troom=item.ToRoom[phase]
		except:
			troom=None
	
		rtn.append([phase, item, froom, troom])
		
OUT = rtn
# ----------------------------------------
python_script_2 = Python(IN[0]=python_script)
# ---------- python_script_2.python (20 lines) ----------
# 加载 Python Standard 和 DesignScript 库
import sys
import clr
clr.AddReference('ProtoGeometry')
from Autodesk.DesignScript.Geometry import *

# 该节点的输入内容将存储为 IN 变量中的一个列表。
data = IN[0]

out = []
only = []
for d in data:
	if d[2] == None or d[3] == None:
		only.append(d)
	else:
		out.append(d)
# 将代码放在该行下面

# 将输出内容指定给 OUT 变量。
OUT = out,only
# ----------------------------------------
code_block_5 = CodeBlock(a=python_script_2) { a[0]; }
transpose = List.Transpose(lists=code_block_5)
code_block_6 = CodeBlock(a=transpose) { a[2]; }
code_block_7 = CodeBlock(e=code_block_6) { e.Name; }
code_block_8 = CodeBlock(a=transpose) { a[3]; }
code_block_9 = CodeBlock(e=code_block_8) { e.Name; }
code_block_10 = CodeBlock(a=code_block_7, b=code_block_9) { a +" 连接 "+ b; }
code_block_11 = CodeBlock { "房间"; }
byName_2 = Category.ByName(name=code_block_11)
all_elements_of_category_2 = ElementsOfCategory(Category=byName_2)
code_block_12 = CodeBlock(e=all_elements_of_category_2) { e.Name; }
code_block_13 = CodeBlock { "Lift"; }
contains = String.Contains(str=code_block_12, searchFor=code_block_13)
filterByBoolMask = List.FilterByBoolMask(list=all_elements_of_category_2, mask=contains)
code_block_14 = CodeBlock(e=filterByBoolMask.in) { e.Name; }
code_block_15 = CodeBlock { "Lobby"; }
contains_2 = String.Contains(str=code_block_12, searchFor=code_block_15)
filterByBoolMask_2 = List.FilterByBoolMask(list=all_elements_of_category_2, mask=contains_2)
location = Room.Location(room=filterByBoolMask.in)
location_2 = Room.Location(room=filterByBoolMask_2.in)
distanceTo = Geometry.DistanceTo(geometry=location, other=location_2, lacing=CrossProduct)

# group: 计算最近的编号
python_script_list_minindex = Python(IN[0]=distanceTo)
# ---------- python_script_list_minindex.python (12 lines) ----------
def tolist(x):
	if hasattr(x,'__iter__'): return x
	return [x]

Alldata = tolist(IN[0])
index = []

for data in Alldata:
	index.append(min(enumerate(data), key=lambda x: x[1]))
OUT = index

#OUT = min(enumerate(data), key=lambda x: x[1])
# ----------------------------------------
transpose_2 = List.Transpose(lists=python_script_list_minindex)
code_block_16 = CodeBlock(a=transpose_2) { a[0]; }

getItemAtIndex = List.GetItemAtIndex(list=filterByBoolMask_2.in, index=code_block_16)
code_block_17 = CodeBlock(e=getItemAtIndex) { e.Name; }
code_block_18 = CodeBlock(a=code_block_14, b=code_block_17) { a +" 连接 "+ b; }
code_block_19 = CodeBlock(a=python_script_2) { a[1]; }
python_script_3 = Python(IN[0]=code_block_19)
# ---------- python_script_3.python (25 lines) ----------
# 加载 Python Standard 和 DesignScript 库
import sys
import clr
clr.AddReference('ProtoGeometry')
from Autodesk.DesignScript.Geometry import *

# 该节点的输入内容将存储为 IN 变量中的一个列表。
data = IN[0]

out = []
only = []
door = []
for d in data:
	if d[2] == None and d[3] != None:
		only.append(d)
		door.append(d[3])
	elif d[2] != None and d[3] == None:
		only.append(d)
		door.append(d[2])
	else:
		out.append(d)
# 将代码放在该行下面

# 将输出内容指定给 OUT 变量。
OUT = out,only,door
# ----------------------------------------
code_block_20 = CodeBlock(a=python_script_3) { a[2]; }
code_block_21 = CodeBlock(e=code_block_20) { e.Name; }
code_block_22 = CodeBlock(a=code_block_21) { a +" 连接 户外"; }
join = List.Join(list0=code_block_10, list1=code_block_18, list2=code_block_22)
code_block_23 = CodeBlock { " 连接 "; }
split = String.Split(str=join, separator0=code_block_23)
transpose_3 = List.Transpose(lists=split)
code_block_24 = CodeBlock(a=transpose_3) { a[0]; }
code_block_25 = CodeBlock { "连接"; }
count = List.Count(list=split)
ofRepeatedItem = List.OfRepeatedItem(item=code_block_25, amount=count)
code_block_26 = CodeBlock(a=transpose_3) { a[1]; }
list_create = List.Create(item0=code_block_24, item1=ofRepeatedItem, item2=code_block_26)
transpose_4 = List.Transpose(lists=list_create)
exportExcel = Data.ExportExcel(filePath=file_path, sheetName=code_block, startRow=code_block_2.out0, startCol=code_block_2.out1, data=transpose_4)
code_block_27 = CodeBlock(e=all_phase) { e.Name; }
