# Dynamo graph space_elements_extraction.dyn "设备所在房间信息2" (Dynamo 2.3.2.15696)

code_block = CodeBlock { ["常规模型","管道附件","数据设备","火警设备","机械设备","喷头"]; }
byName = Category.ByName(name=code_block)
all_elements_of_category = ElementsOfCategory(Category=byName)
flatten = List.Flatten(list=all_elements_of_category)
getLocation = Element.GetLocation(element=flatten)  # frozen
flatten_2 = List.Flatten(list=getLocation)
code_block_2 = CodeBlock { "房间"; }
byName_2 = Category.ByName(name=code_block_2)
all_elements_of_category_2 = ElementsOfCategory(Category=byName_2)

# group: 求设备几何中心
boundingBox = Element.BoundingBox(element=flatten)
minPoint = BoundingBox.MinPoint(boundingBox=boundingBox)
maxPoint = BoundingBox.MaxPoint(boundingBox=boundingBox)
byStartPointEndPoint = Line.ByStartPointEndPoint(startPoint=minPoint, endPoint=maxPoint)
code_block_3 = CodeBlock { 0.5; }
pointAtParameter = Curve.PointAtParameter(curve=byStartPointEndPoint, param=code_block_3)

# group: 查找设备所在房间
isInsideRoom = Room.IsInsideRoom(room=all_elements_of_category_2, point=pointAtParameter@L1)
filterByBoolMask = List.FilterByBoolMask(list=all_elements_of_category_2, mask=isInsideRoom@L2)

# group: 过滤掉房间以外的设备
code_block_4 = CodeBlock(a=filterByBoolMask.in) { a; }
code_block_5 = CodeBlock { ""; }

name = Element.Name(element=code_block_4)

# group (continued): 过滤掉房间以外的设备
python_script = Python(IN[0]=name)
# ---------- python_script.python (20 lines) ----------
# 加载 Python Standard 和 DesignScript 库
import sys
import clr
clr.AddReference('ProtoGeometry')
from Autodesk.DesignScript.Geometry import *

# 该节点的输入内容将存储为 IN 变量中的一个列表。
data = IN[0]

out = []
for d in data:
	if d != []:
		out.append(d[0])
	else:
		out.append("")

# 将代码放在该行下面

# 将输出内容指定给 OUT 变量。
OUT = out
# ----------------------------------------
eq = python_script == code_block_5
filterByBoolMask_2 = List.FilterByBoolMask(list=python_script, mask=eq)

# group: 获取设备族和族类型名称
filterByBoolMask_3 = List.FilterByBoolMask(list=flatten, mask=eq)
getFamily = FamilyInstance.GetFamily(familyInstance=filterByBoolMask_3.out)
code_block_6 = CodeBlock(e=getFamily) { e.Name; }
code_block_7 = CodeBlock(e=filterByBoolMask_3.out) { e.Name; }
code_block_8 = CodeBlock(f=code_block_6, t=code_block_7) { f+":"+t; }
code_block_9 = CodeBlock { "有"; }
count = List.Count(list=code_block_8)
ofRepeatedItem = List.OfRepeatedItem(item=code_block_9, amount=count)

sortByKey = List.SortByKey(list=filterByBoolMask_2.out, keys=code_block_8)

# group: 排序，求重复数量
python_script_2 = Python(IN[0]=sortByKey.sorted_keys)
# ---------- python_script_2.python (24 lines) ----------
def count_consecutive_elements(lst):
    count = 1
    ele = []
    num = []
    
    for i in range(len(lst) - 1):
        if lst[i] == lst[i+1]:
            count += 1
        else:
            ele.append(lst[i],)
            num.append(count)
            count = 1
    
    ele.append(lst[-1])
    num.append(count)
    
    return ele,num

# 示例用法
my_list = IN[0]

consecutive_counts = count_consecutive_elements(my_list)

OUT = consecutive_counts
# ----------------------------------------
code_block_10 = CodeBlock(a=python_script_2) { a[1]; }

# group: 同房间相同设备编号
python_script_3 = Python(IN[0]=code_block_10)
# ---------- python_script_3.python (21 lines) ----------
# 加载 Python Standard 和 DesignScript 库
import sys
import clr
clr.AddReference('ProtoGeometry')
from Autodesk.DesignScript.Geometry import *

# 该节点的输入内容将存储为 IN 变量中的一个列表。
data = IN[0]
out = []
for d in data:
	if d == 1:
		out.append("")
	else:
		lst = range(1,d+1)
		for l in lst:
			out.append(l)		

# 将代码放在该行下面

# 将输出内容指定给 OUT 变量。
OUT = out
# ----------------------------------------
string_from_object = FromObject(obj=python_script_3)
code_block_11 = CodeBlock { 3; }
code_block_12 = CodeBlock { "0"; }
padLeft = String.PadLeft(str=string_from_object, newWidth=code_block_11, padChars=code_block_12)
python_script_4 = Python(IN[0]=padLeft)
# ---------- python_script_4.python (20 lines) ----------
# 加载 Python Standard 和 DesignScript 库
import sys
import clr
clr.AddReference('ProtoGeometry')
from Autodesk.DesignScript.Geometry import *

# 该节点的输入内容将存储为 IN 变量中的一个列表。
data = IN[0]
out = []

for d in data:
	if d == "000":
		out.append("")
	else:
		out.append("-"+d)

# 将代码放在该行下面

# 将输出内容指定给 OUT 变量。
OUT = out
# ----------------------------------------

code_block_13 = CodeBlock(a=sortByKey.sorted_keys, b=python_script_4) { a+b; }

# group: 合并数据，写入Excel
file_path = Filename(".\房间设备信息导出1.xlsx")
code_block_14 = CodeBlock { "Sheet1"; }
code_block_15 = CodeBlock { 0; 0; }
list_create = List.Create(item0=sortByKey.sorted_list, item1=ofRepeatedItem, item2=code_block_13)
transpose = List.Transpose(lists=list_create)
exportExcel = Data.ExportExcel(filePath=file_path, sheetName=code_block_14, startRow=code_block_15.out0, startCol=code_block_15.out1, data=transpose)
